vi "Main.gvi"   [LabVIEW NXG 3.0.0]
panel controls:
  "Stop": bool
  "Settings": i32
  "Inflow (cfs)": f64 = 1000
  "Large Floodgates Status": bool[] = [FALSE, FALSE, FALSE, FALSE]
  "Small Floodgates Status": bool[] = [FALSE, FALSE, FALSE, FALSE]
  "Turbines Status": bool[] = [FALSE, TRUE, FALSE, FALSE]
  "Turbines Open Gap (%)": f64[] = [41.8597271091, 60.594530904]
  "Reset": bool
panel indicators:
  "Lake Fill (Acre-feet)": f64
  "Inflow (cfs) reading": string
  "Total Power Generation": f64
  "Log Path": path
  "error out": error
uses:
  Dam.gtype::Close.gvi
  Dam.gtype::Update Dam.gvi
  Dam.gtype::Log Status.gvi
  Dam.gtype::Init.gvi
  NI::G Core::Error::Multiplex Errors.gvi
  NI::G Core::Error::Display Error.gvi
diagram:
  call "Open QMH.gvi"() -> (Message Queue=w1, Stop Event=w2, error out=w3)
  call "Send Message.gvi"(Queue in=w1, Command="Initialize", Input=w3) -> (Queue out=w4, Output=w5)
  Register For Events("Stop Event"=w2, error in=w5) -> (error out=w6, event registration refnum out=w7)
  s1 = w6  # shift register
  while {
    event (timeout = 50) (dynamic events = w7) {
      on "Stop" Value changed {
        call "Send Message.gvi"(Queue in=w4, Command="Stop", Data=s1, Input=s1) -> (Output=w9)
        w8 = default
      }
      on "Dynamic" Stop Event {
        Event Data() -> ("event data"=w8)
        w9 = s1
      }
      on Timeout {
        call "Update Dam and Log.gvi"(Message Queue In=w4, Dam Update Time=1, Log Time=60, Error Input=s1) -> (Error Output=w9)
        w8 = default
      }
    }
    call "Error Check.gvi"(Message Queue In=w4, Error In=w9) -> (Message Queue Out=w10, Error Output=w11)
    next s1 = w11
    stop if w8
  }
  s2 = "Dam.gtype" constant  # shift register
  while {
    call "Read Message.gvi"(Message Queue In=w4, Error in=w6) -> (Message Queue Out=w12, Command=w13, Data=w14, Error out=w15)
    case (w13) {
      frame Default {
        w16 = w15
        w17 = default
        w18 = s2
      }
      frame "Stop" {
        Variant To Data(error in (no error)=w15, type=w15, variant=w14) -> (data=w19, error out=w20)
        Generate User Event(error in=w20, event data=TRUE, user event=w2) -> (error out=w21)
        call "Close.gvi"(Dam in=s2, Error in=w21) -> (Error out=w22)
        Merge Errors(w19, w22) -> (error out=w16)
        w17 = TRUE
        w18 = "Dam.gtype" constant
      }
      frame "Update Dam" {
        call "Update Dam.gvi"(Dam in=s2, Error in=w15) -> (Dam out=w18, Fill (Acre-feet)=w23, Error out=w16)
        $"Lake Fill (Acre-feet)" <- w23
        w17 = default
      }
      frame "Log" {
        call "Log Status.gvi"(Dam in=s2, Error in=w15) -> (Dam out=w18, Error out=w16)
        w17 = default
      }
      frame "Initialize" {
        call "Init.gvi"(Error in=w15) -> (Dam out=w18, Log Path Out=w24, Error out=w16)
        $"Log Path" <- w24
        w17 = default
      }
    }
    call "Error Check.gvi"(Message Queue In=w12, Error In=w16) -> (Error Output=w25)
    next s2 = w18
    stop if w17
  }
  call "Multiplex Errors.gvi"(error in 1=s1, error in 2=w25) -> (error out=w26)
  Unregister For Events(error in=w26, event registration refnum=w7) -> (error out=w27)
  call "Close QMH.gvi"(Message Queue=w10, Stop Event=w2, error in=w27) -> (error out=w28)
  $"error out" <- w28
  call "Display Error.gvi"(error in=w28)
